# Grasshopper definition updated_units_june_1V2.gh (Grasshopper 1.0.8)
# plug-ins: Pufferfish, Weaverbird, NGon_RH8

crv = Curve([<curve referenced from the Rhino model> x39])
number_slider = Slider(3, range=0..10)
number_slider_2 = Slider(1, range=0..1)
number_slider_3 = Slider(15, range=0..100)
number_slider_4 = Slider(0, range=0..100)
bbox = BoundingBox(Content=crv, Plane=PlaneXY(0, 0, 0), UnionBox=True)  # -> Box, Box_2
arrbox = BoxArray(Geometry=crv, Cell=bbox.Box, XCount=number_slider_2, YCount=number_slider_2, ZCount=number_slider_2)  # -> Geometry, Transform
vec = VectorXYZ(XComponent=number_slider_3, YComponent=number_slider_3, ZComponent=number_slider_3)  # -> Vector, Length
number_slider_5 = Slider(15, range=0..20)
move = Move(Geometry=bbox.Box, Motion=vec.Vector)  # -> Geometry, Transform
dupln = RemoveDuplicateLines(Lines=flatten(arrbox.Geometry), Tolerance=0.01)
debrep = DeconstructBrep(Brep=move.Geometry)  # -> Faces, Edges, Vertices
number_slider_6 = Slider(1, range=0..10)
number_slider_7 = Slider(0.75, range=0..10)
pln = Plane(debrep.Faces)
number_slider_8 = Slider(0, range=0..1)
number_slider_9 = Slider(50, range=0..100)
number_slider_10 = Slider(15, range=0..100)
bbox_2 = BoundingBox(Content=crv, Plane=PlaneXY(0, 0, 0), UnionBox=True)  # -> Box, Box_2
number_slider_11 = Slider(3, range=0..10)
number_slider_12 = Slider(3, range=0..10)
mp = MultiPipe(
    Curves=dupln,
    NodeSize=number_slider_7,
    EndOffset=number_slider_8,
    StrutSize=number_slider_6,
    Segment=0,
    KinkAngle=0.6,
    CubeFit=number_slider_9,
    Caps=0)
mp_2 = MultiPipe(
    Curves=dupln,
    NodeSize=number_slider_7,
    EndOffset=number_slider_8,
    StrutSize=number_slider_6,
    Segment=0,
    KinkAngle=0.6,
    CubeFit=number_slider_9,
    Caps=0)
vec_2 = VectorXYZ(XComponent=number_slider_10, YComponent=number_slider_10, ZComponent=number_slider_10)  # -> Vector, Length
panel = Panel(mp)
move_2 = Move(Geometry=mp, Motion=vec_2.Vector)  # -> Geometry, Transform
neg = Negative(Value=Slider(1, range=0..10))
tobrep = SubDToBrep(SubD=move_2.Geometry, Packing=True, Continuity=Slider(4, range=0..10))
offsetsubd = OffsetSUBD(subd=mp_2, offset=neg, trueorfalse=Toggle(False))
brep = Brep(tobrep)

panel_2 = Panel("""0
2""")
item = ListItem(List=pln, Index=panel_2, Wrap=True)
item_2 = ListItem(List=debrep.Faces, Index=panel_2, Wrap=True)
scale = Scale(Geometry=item_2, Center=item, Factor=number_slider_5)  # -> Geometry, Transform
splitmul = SplitBrepMultiple(Brep=brep, Cutters=scale.Geometry)
item_3 = ListItem(List=splitmul, Index=Slider(0, range=0..10), Wrap=True)
cap = CapHoles(Brep=item_3)
panel_3 = Panel(cap)

panel_4 = Panel("""4
5""")
item_4 = ListItem(List=pln, Index=panel_4, Wrap=True)
item_5 = ListItem(List=debrep.Faces, Index=panel_4, Wrap=True)
scale_2 = Scale(Geometry=item_5, Center=item_4, Factor=number_slider_5)  # -> Geometry, Transform
splitmul_2 = SplitBrepMultiple(Brep=cap, Cutters=scale_2.Geometry)
panel_5 = Panel(splitmul_2)
item_6 = ListItem(List=splitmul_2, Index=Slider(0, range=0..10), Wrap=True)
cap_2 = CapHoles(Brep=item_6)

panel_6 = Panel("""1
3""")
item_7 = ListItem(List=pln, Index=panel_6, Wrap=True)
item_8 = ListItem(List=debrep.Faces, Index=panel_6, Wrap=True)
scale_3 = Scale(Geometry=item_8, Center=item_7, Factor=number_slider_5)  # -> Geometry, Transform
splitmul_3 = SplitBrepMultiple(Brep=cap_2, Cutters=scale_3.Geometry)
panel_7 = Panel(splitmul_3)
item_9 = ListItem(List=splitmul_3, Index=Slider(1, range=0..10), Wrap=True)
cap_3 = CapHoles(Brep=item_9)

subdpoly = SubDControlPolygon(SubD=mp)
arrbox_2 = BoxArray(Geometry=mp, Cell=bbox_2.Box, XCount=Slider(1, range=0..1), YCount=number_slider_12, ZCount=number_slider_12)  # -> Geometry, Transform
preview = CustomPreview(
    Geometry=brep,
    Material={diffuse=RGB(228, 178, 227), emission=RGB(68, 53, 68), shine=0.5, specular=RGB(255, 254, 255), transparency=0})
move_3 = Move(Geometry=offsetsubd, Motion=vec.Vector)  # -> Geometry, Transform
preview_2 = CustomPreview(
    Geometry=move_3.Geometry,
    Material={diffuse=RGB(228, 178, 227), emission=RGB(68, 53, 68), shine=0.5, specular=RGB(255, 254, 255), transparency=0})
geo = Geometry(move_2.Geometry)

number_slider_13 = Slider(30, range=0..100)
neg_2 = Negative(Value=number_slider_13)
item_10 = ListItem(List=scale.Geometry, Index=Slider(0, range=0..10), Wrap=True)
Y = UnitY(Factor=neg_2)
extr = Extrude(Base=item_10, Direction=Y)
item_11 = ListItem(List=scale.Geometry, Index=Slider(1, range=0..10), Wrap=True)
sdiff = SolidDifference(BrepsA=geo, BrepsB=extr)
Y_2 = UnitY(Factor=number_slider_13)
extr_2 = Extrude(Base=item_11, Direction=Y_2)
sdiff_2 = SolidDifference(BrepsA=sdiff, BrepsB=extr_2)
geo_2 = Geometry(sdiff_2)

panel_8 = Panel(cap_2)

number_slider_14 = Slider(30, range=0..100)
neg_3 = Negative(Value=number_slider_14)
item_12 = ListItem(List=scale_3.Geometry, Index=Slider(0, range=0..10), Wrap=True)
X = UnitX(Factor=number_slider_14)
item_13 = ListItem(List=scale_3.Geometry, Index=Slider(1, range=0..10), Wrap=True)
extr_3 = Extrude(Base=item_12, Direction=X)
X_2 = UnitX(Factor=neg_3)
sdiff_3 = SolidDifference(BrepsA=sdiff_2, BrepsB=extr_3)
extr_4 = Extrude(Base=item_13, Direction=X_2)
sdiff_4 = SolidDifference(BrepsA=sdiff_3, BrepsB=extr_4)
geo_3 = Geometry(sdiff_4)

panel_9 = Panel(cap_3)

number_slider_15 = Slider(30, range=0..100)
neg_4 = Negative(Value=number_slider_15)
Z = UnitZ(Factor=neg_4)
item_14 = ListItem(List=scale_2.Geometry, Index=Slider(0, range=0..10), Wrap=True)
Z_2 = UnitZ(Factor=number_slider_15)
extr_5 = Extrude(Base=item_14, Direction=Z)
item_15 = ListItem(List=scale_2.Geometry, Index=Slider(1, range=0..10), Wrap=True)
sdiff_5 = SolidDifference(BrepsA=sdiff_4, BrepsB=extr_5)
extr_6 = Extrude(Base=item_15, Direction=Z_2)
sdiff_6 = SolidDifference(BrepsA=sdiff_5, BrepsB=extr_6)
geo_4 = Geometry(sdiff_6)

mesh = Mesh(cap_3)
wbblur = WeaverbirdsBlurMesh(MeshCurves=mesh, Level=Slider(5, range=0..10), Thin=1)
rebmsh = RebuildMesh(
    Mesh=mesh,
    RebuildNormals=True,
    CullUnused=True,
    UnifyNormals=True,
    FlipNormals=False,
    IdenticalCombine=True,
    WeldVertices=0)
neg_5 = Negative(Value=Slider(0.4, range=0..10))
offmsh = OffsetMesh(Mesh=rebmsh, Distance=neg_5, BothSides=0, CreateSolid=False)
mesh_2 = Mesh(geo_4)
meshskeleton = MeshSkeleton(Mesh=offmsh)  # -> Skeleton, _3ValenceLines, NakedPoints, AllEndPoints
crv_2 = Curve(meshskeleton.Skeleton)

# ---- group: LED Slots
crv_3 = Curve(<curve referenced from the Rhino model>)
number_slider_16 = Slider(0, range=0..10)
number_slider_17 = Slider(4, range=0..10)
crv_4 = Curve([<curve referenced from the Rhino model> x4])
explode = ExplodeObject(Object=crv_3, Recursive=False)
end = EndPoints(Curve=explode)  # -> Start, End
item_16 = ListItem(List=crv_4, Index=number_slider_17, Wrap=True)
shift = ShiftList(List=end.Start, Shift=Slider(2, range=0..10), Wrap=True)
item_17 = ListItem(List=shift, Index=number_slider_17, Wrap=True)
curvepoint = PointOnCurve(crv_4, parameter=0.8)
curvepoint_2 = PointOnCurve(crv_4, parameter=0.169)
ln = Line(StartPoint=curvepoint_2, EndPoint=curvepoint)
pl_3pt = Plane3Pt(PointA=curvepoint_2, PointB=curvepoint, PointC=shift)
curvepoint_3 = PointOnCurve(ln, parameter=0.5)
deplane = DeconstructPlane(Plane=pl_3pt)  # -> Origin, XAxis, YAxis, ZAxis
number_slider_18 = Slider(0.5, range=0..10)
neg_6 = Negative(Value=Slider(3, range=0..10))
unit = UnitVector(Vector=deplane.ZAxis)
multiplication = Multiplication(A=neg_6, B=unit)
extr_7 = Extrude(Base=ln, Direction=multiplication)
neg_7 = Negative(Value=number_slider_18)
unit_2 = UnitVector(Vector=extr_7)
multiplication_2 = Multiplication(A=neg_7, B=unit_2)
multiplication_3 = Multiplication(A=number_slider_18, B=unit_2)
extr_8 = Extrude(Base=extr_7, Direction=multiplication_2)
extr_9 = Extrude(Base=extr_7, Direction=multiplication_3)
sunion = SolidUnion(Breps=[extr_8, extr_9])

# ----
bbox_3 = BoundingBox(Content=crv, Plane=PlaneXY(0, 0, 0), UnionBox=True)  # -> Box, Box_2
area = Area(Geometry=bbox_3.Box)  # -> Area, Centroid
xy = XYPlane(Origin=area.Centroid)
move_4 = Move(Geometry=sunion, Motion=vec.Vector)  # -> Geometry, Transform
sdiff_7 = SolidDifference(BrepsA=cap_3, BrepsB=move_4.Geometry)
neg_8 = Negative(Value=Slider(15, range=0..100))
vec_3 = VectorXYZ(XComponent=neg_8, YComponent=neg_8, ZComponent=neg_8)  # -> Vector, Length

# ---- group: Side structural connections
number_slider_19 = Slider(1, range=0..10)
crv_5 = Curve([<curve referenced from the Rhino model> x4])
explode_2 = ExplodeObject(Object=crv_5, Recursive=False)
neg_9 = Negative(Value=Slider(15, range=0..100))
item_18 = ListItem(List=explode_2, Index=0, Wrap=True)  # -> flatten(Item)
item_19 = ListItem(List=explode_2, Index=number_slider_19, Wrap=True)  # -> flatten(Item)
Z_3 = UnitZ(Factor=neg_9)
shift_2 = ShiftList(List=flatten(item_18), Shift=number_slider_19, Wrap=True)  # -> flatten(List)
item_20 = ListItem(List=shift_2, Index=0, Wrap=True)
merge = Merge(Data1=graft(shift_2), Data2=graft(item_19))
loft = Loft(Curves=merge, Options={Adjust=False, Closed=False, LoftEnds=0, LoftSimp=0, LoftType=0, Rebuild=10, Refit=0.01})  # -> flatten(Loft)
neg_10 = Negative(Value=Slider(1, range=0..1))
deplane_2 = DeconstructPlane(Plane=loft)  # -> Origin, XAxis, YAxis, ZAxis
crv_6 = Curve(item_19)
multiplication_4 = Multiplication(A=deplane_2.ZAxis, B=neg_10)
curvepoint_4 = PointOnCurve(crv_6, parameter=0.11)

# ---- group: Wire slots
group = Group(Geometry=flatten(explode_2))
bbox_4 = BoundingBox(Content=group, Plane=PlaneXY(0, 0, 0))  # -> Box, Box_2
crv_7 = Curve(flatten(item_18))
area_2 = Area(Geometry=bbox_4.Box)  # -> Area, flatten(Centroid)
crv_8 = Curve(flatten(item_19))
curvepoint_5 = PointOnCurve(crv_7, parameter=0.301)
curvepoint_6 = PointOnCurve(crv_7, parameter=1)
ln_2 = Line(StartPoint=area_2.Centroid, EndPoint=curvepoint_6)  # -> flatten(Line)
curvepoint_7 = PointOnCurve(ln_2, parameter=0.615)
curvepoint_8 = PointOnCurve(crv_8, parameter=0.699)
repeat = RepeatData(Data=area_2.Centroid, Length=Slider(4, range=0..10))  # -> flatten(Data)
merge_2 = Merge(Data1=graft(curvepoint_7), Data2=graft(curvepoint_5), Data3=graft(curvepoint_6), Data4=graft(curvepoint_8))
neg_11 = Negative(Value=Slider(0.65, range=0..10))
pline = PolyLine(Vertices=merge_2, Closed=Toggle(True))
offset = OffsetCurve(Curve=pline, Distance=neg_11, Corners=1)
boundary = BoundarySurfaces(Edges=offset)
number_slider_20 = Slider(0.5, range=0..10)
deplane_3 = DeconstructPlane(Plane=boundary)  # -> Origin, XAxis, YAxis, ZAxis
unit_3 = UnitVector(Vector=deplane_3.ZAxis)
neg_12 = Negative(Value=number_slider_20)
multiplication_5 = Multiplication(A=unit_3, B=number_slider_20)
multiplication_6 = Multiplication(A=unit_3, B=neg_12)
extr_10 = Extrude(Base=boundary, Direction=multiplication_5)
extr_11 = Extrude(Base=boundary, Direction=multiplication_6)
join = BrepJoin(Breps=flatten([extr_10, extr_11]))  # -> Breps, Closed
sunion_2 = SolidUnion(Breps=join.Breps)
move_5 = Move(Geometry=sunion_2, Motion=vec.Vector)  # -> Geometry, Transform

# ---- group: up and down stuctural connections
brep_2 = Brep([<brep referenced from the Rhino model> x2])
sunion_3 = SolidUnion(Breps=brep_2)
shift_3 = ShiftList(List=end.Start, Shift=Slider(1, range=0..10), Wrap=True)
shift_4 = ShiftList(List=shift_3, Shift=Slider(2, range=0..10), Wrap=True)
item_21 = ListItem(List=shift_3, Index=0, Wrap=True)
vec2pt = Vector2Pt(PointA=item_21, PointB=shift_3, Unitize=False)  # -> Vector, Length
ln_3 = Line(StartPoint=shift_3, EndPoint=shift_4)
move_6 = Move(Geometry=sunion_3, Motion=vec2pt.Vector)  # -> Geometry, Transform
ln_4 = Line(StartPoint=shift_3, EndPoint=shift_4)
unit_4 = UnitVector(Vector=ln_3)
multiplication_7 = Multiplication(A=unit_4, B=Slider(2, range=0..10))
move_7 = Move(Geometry=move_6.Geometry, Motion=multiplication_7)  # -> Geometry, Transform
mirror = Mirror(Geometry=move_7.Geometry, Plane=xy)  # -> Geometry, Transform

# ---- group: Side structural connections (continued)
move_8 = Move(Geometry=item_21, Motion=Z_3)  # -> Geometry, Transform
Z_4 = UnitZ(Factor=move_8.Geometry)
rotate = RotateDirection(Geometry=sunion_3, Center=move_8.Geometry, From=Z_4, To=multiplication_4)  # -> Geometry, Transform
vec2pt_2 = Vector2Pt(PointA=move_8.Geometry, PointB=curvepoint_4, Unitize=False)  # -> Vector, Length
move_9 = Move(Geometry=rotate.Geometry, Motion=vec2pt_2.Vector)  # -> Geometry, Transform
move_10 = Move(Geometry=move_9.Geometry, Motion=vec.Vector)  # -> Geometry, Transform

# ----
merge_3 = Merge(Data1=move_7.Geometry, Data2=mirror.Geometry)

# ---- group: up and down stuctural connections (continued)
move_11 = Move(Geometry=merge_3, Motion=vec.Vector)  # -> Geometry, Transform

# ----
sdiff_8 = SolidDifference(BrepsA=sdiff_7, BrepsB=move_10.Geometry)
sdiff_9 = SolidDifference(BrepsA=sdiff_8, BrepsB=move_5.Geometry)
sdiff_10 = SolidDifference(BrepsA=sdiff_9, BrepsB=move_11.Geometry)
panel_10 = Panel(sdiff_9)
sdiff_11 = SolidDifference(BrepsA=sdiff_10, BrepsB=move_3.Geometry)
move_12 = Move(Geometry=sdiff_11, Motion=vec_3.Vector)  # -> Geometry, Transform

# ==== cluster OffsetSUBD: well, offsetSUBD. duh
trueorfalse = ClusterInput()
offset = ClusterInput()
subd = ClusterInput()
py3 = Python3Script(subd=subd, offset=offset, trueorfalse=trueorfalse)  # -> out, offsetSubd; inputs subd: SubD, offset: Double, trueorfalse: Boolean
# ---------- py3: Python ----------
offsetSubd = subd.Offset(offset,trueorfalse)
# ---------- end py3 ----------
offsetsubd = ClusterOutput(py3.offsetSubd)
