# Grasshopper definition updated_units_june_1_CLEAN_OFFSETS.gh (Grasshopper 1.0.8)

# NOTE: 1 INPUT
# Rhino curves from Layer 04 define the centerline network. Open the Rhino V2 file first.
crv = Curve([<curve referenced from the Rhino model> x39])
array_count = Slider(1, range=0..1)
bbox = BoundingBox(Content=crv, Plane=PlaneXY(0, 0, 0), UnionBox=True)  # -> Box, Box_2
# NOTE: 2 CLEAN NETWORK
# Box Array repeats the curve cell. removeDuplicateLines deletes overlapping lines before piping.
arrbox = BoxArray(Geometry=crv, Cell=bbox.Box, XCount=array_count, YCount=array_count, ZCount=array_count)  # -> Geometry, Transform
dupln = RemoveDuplicateLines(Lines=flatten(arrbox.Geometry), Tolerance=0.01)
# NOTE: 4 OFFSET 1
# Signed offset from the base SubD. Default 0, so Body 1 is the reference NURBS body.
base_radius = Slider(0.75, range=0..10)
strut_size = Slider(1, range=0..10)
end_offset = Slider(0, range=0..1)
# NOTE: 3 BASE SUBD
# MultiPipe creates the source SubD. BASE RADIUS and STRUT SIZE control the source body.
cube_fit = Slider(50, range=0..100)
nurbs_continuity = Slider(4, range=0..10)
# NOTE: 5 OFFSET 2
# Signed offset from the same base SubD. Default -1, so Body 2 is inward.
offset_2 = Slider(-0.4, range=-10..10)
offset_1 = Slider(0.1, range=-10..10)
run_offset = BooleanToggle(False)
mp = MultiPipe(
    Curves=dupln,
    NodeSize=base_radius,
    EndOffset=end_offset,
    StrutSize=strut_size,
    Segment=0,
    KinkAngle=0.6,
    CubeFit=cube_fit,
    Caps=0)
offset_1_subd = OffsetSUBD(subd=mp, offset=offset_1, trueorfalse=run_offset)
offset_2_subd = OffsetSUBD(subd=mp, offset=offset_2, trueorfalse=run_offset)
offset_1_to_nurbs = SubDToBrep(SubD=offset_1_subd, Packing=True, Continuity=nurbs_continuity)
offset_2_to_nurbs = SubDToBrep(SubD=offset_2_subd, Packing=True, Continuity=nurbs_continuity)
body_1_nurbs = Brep(offset_1_to_nurbs)
# NOTE: 6 OUTPUTS
# BODY 1 NURBS and BODY 2 NURBS are visible and bakeable. No boolean difference yet.
body_2_nurbs = Brep(offset_2_to_nurbs)
preview_body_1 = CustomPreview(
    Geometry=body_1_nurbs,
    Material={diffuse=RGB(228, 178, 227), emission=RGB(68, 53, 68), shine=0.5, specular=RGB(255, 254, 255), transparency=0})
preview_body_2 = CustomPreview(
    Geometry=body_2_nurbs,
    Material={diffuse=RGB(228, 178, 227), emission=RGB(68, 53, 68), shine=0.5, specular=RGB(255, 254, 255), transparency=0})
pt = Point(<point referenced from the Rhino model>)
pt_2 = Point(<point referenced from the Rhino model>)
pt_3 = Point(<point referenced from the Rhino model>)
number_slider = Slider(2, range=0..360)
ln = Line(StartPoint=pt, EndPoint=pt_2)
vec2pt = Vector2Pt(PointA=pt, PointB=pt_2, Unitize=False)  # -> Vector, Length
rad = Radians(Degrees=Slider(90, range=0..360))
division = Division(A=vec2pt.Vector, B=number_slider)
move = Move(Geometry=ln, Motion=division)  # -> Geometry, Transform
xy = XYPlane(Origin=pt_2)
addition = Addition(A=offset_1, B=offset_2)
multiplication = Multiplication(B=number_slider)
rotate = Rotate(Geometry=move.Geometry, Angle=rad, Plane=xy)  # -> Geometry, Transform
vec2pt_2 = Vector2Pt(PointA=pt_2, PointB=pt_3, Unitize=False)  # -> Vector, Length
panel = Panel(addition)
ln_2 = Line(StartPoint=pt_3, EndPoint=pt_2)
midpt = CurveMiddle(Curve=ln)
extr = Extrude(Base=rotate.Geometry, Direction=vec2pt_2.Vector)
vec2pt_3 = Vector2Pt(PointA=pt_2, PointB=pt, Unitize=False)  # -> Vector, Length
xy_2 = XYPlane(Origin=midpt)
midpt_2 = CurveMiddle(Curve=ln_2)
division_2 = Division(A=vec2pt_2.Vector, B=number_slider)
move_2 = Move(Geometry=xy_2, Motion=division_2)  # -> Geometry, Transform
subtraction = Subtraction(A=Slider(0.627, range=0..1), B=panel)
boxrec = BoxRectangle(Rectangle=extr, Height=vec2pt_3.Vector)
scale_nu = ScaleNU(Geometry=boxrec, Plane=move_2.Geometry, ScaleX=subtraction, ScaleY=subtraction, ScaleZ=subtraction)  # -> Geometry, Transform
sint = SolidIntersection(BrepsA=scale_nu.Geometry, BrepsB=body_2_nurbs)
sint_2 = SolidIntersection(BrepsA=boxrec, BrepsB=body_1_nurbs)

# ==== cluster OffsetSUBD: well, offsetSUBD. duh
trueorfalse = ClusterInput()
offset = ClusterInput()
subd = ClusterInput()
py3 = Python3Script(subd=subd, offset=offset, trueorfalse=trueorfalse)  # -> out, offsetSubd; inputs subd: SubD, offset: Double, trueorfalse: Boolean
# ---------- py3: Python ----------
offsetSubd = subd.Offset(offset,trueorfalse)
# ---------- end py3 ----------
offsetsubd = ClusterOutput(py3.offsetSubd)
