# Grasshopper definition updated_units_june_1_CLEAN_OFFSETS.ghx (Grasshopper 1.0.8)
# plug-ins: Pufferfish, Weaverbird, NGon_RH8

# NOTE: 1 INPUT
# Rhino curves from Layer 04 define the centerline network. Open the Rhino V2 file first.
crv = Curve([<curve referenced from the Rhino model> x39])
array_count = Slider(1, range=0..1)
bbox = BoundingBox(Content=crv, Plane=PlaneXY(0, 0, 0), UnionBox=True)  # -> Box, Box_2
# NOTE: 2 CLEAN NETWORK
# Box Array repeats the curve cell. removeDuplicateLines deletes overlapping lines before piping.
arrbox = BoxArray(Geometry=crv, Cell=bbox.Box, XCount=array_count, YCount=array_count, ZCount=array_count)  # -> Geometry, Transform
dupln = RemoveDuplicateLines(Lines=flatten(arrbox.Geometry), Tolerance=0.01)
base_radius = Slider(0.75, range=0..10)
strut_size = Slider(1, range=0..10)
end_offset = Slider(0, range=0..1)
# NOTE: 3 BASE SUBD
# MultiPipe creates the source SubD. BASE RADIUS and STRUT SIZE control the source body.
cube_fit = Slider(50, range=0..100)
nurbs_continuity = Slider(4, range=0..10)
mp = MultiPipe(
    Curves=dupln,
    NodeSize=base_radius,
    EndOffset=end_offset,
    StrutSize=strut_size,
    Segment=0,
    KinkAngle=0.6,
    CubeFit=cube_fit,
    Caps=0)
# NOTE: 4 OFFSET 1
# Signed offset from the base SubD. Default 0, so Body 1 is the reference NURBS body.
offset_1 = Slider(0, range=-10..10)
run_offset = BooleanToggle(False)
# NOTE: 5 OFFSET 2
# Signed offset from the same base SubD. Default -1, so Body 2 is inward.
offset_2 = Slider(-1, range=-10..10)
offset_1_subd = OffsetSUBD(subd=mp, offset=offset_1, trueorfalse=run_offset)
offset_2_subd = OffsetSUBD(subd=mp, offset=offset_2, trueorfalse=run_offset)
offset_1_to_nurbs = SubDToBrep(SubD=offset_1_subd, Packing=True, Continuity=nurbs_continuity)
offset_2_to_nurbs = SubDToBrep(SubD=offset_2_subd, Packing=True, Continuity=nurbs_continuity)
body_1_nurbs = Brep(offset_1_to_nurbs)
# NOTE: 6 OUTPUTS
# BODY 1 NURBS and BODY 2 NURBS are visible and bakeable. No boolean difference yet.
body_2_nurbs = Brep(offset_2_to_nurbs)
preview_body_1 = CustomPreview(
    Geometry=body_1_nurbs,
    Material={diffuse=RGB(228, 178, 227), emission=RGB(68, 53, 68), shine=0.5, specular=RGB(255, 254, 255), transparency=0})
preview_body_2 = CustomPreview(
    Geometry=body_2_nurbs,
    Material={diffuse=RGB(228, 178, 227), emission=RGB(68, 53, 68), shine=0.5, specular=RGB(255, 254, 255), transparency=0})

# ==== cluster OffsetSUBD: well, offsetSUBD. duh
trueorfalse = ClusterInput()
offset = ClusterInput()
subd = ClusterInput()
py3 = Python3Script(subd=subd, offset=offset, trueorfalse=trueorfalse)  # -> out, offsetSubd; inputs subd: SubD, offset: Double, trueorfalse: Boolean
# ---------- py3: Python ----------
offsetSubd = subd.Offset(offset,trueorfalse)
# ---------- end py3 ----------
offsetsubd = ClusterOutput(py3.offsetSubd)
